# Grasshopper definition hairworm_basic_example.ghx (Grasshopper 0.9.64)
# plug-ins: Hairworm

# https://github.com/provolot/GrasshopperExchange/raw/master/Hairworm/_example_files/NestedSpheres.ghx
panel = Panel("https://github.com/provolot/GrasshopperExchange/raw/master/Hairworm/_example_files\RandomSphereMaker.ghx")
# https://github.com/provolot/GrasshopperExchange/raw/master/Hairworm/_example_files/SphereMaker.ghcluster
# https://github.com/provolot/GrasshopperExchange/raw/master/Hairworm/_example_files/HexagridOnSrf.ghx
panel_2 = Panel("https://raw.github.com/provolot/GrasshopperExchange/master/Hairworm/_example_files/BoxSphereMakerVariableghx.ghx")
number_slider = Slider(33, range=0..100)
panel_3 = Panel("3")
geo = Geometry()
graft = GraftTree(Tree=panel_2, IncludeEmptyLists=True, IncludeNullItems=True)
hairworm_randomspheremaker = HairwormRandomSphereMaker(ClusterURL=panel, PairNum=Slider(8, range=0..10))  # -> Debug, ResultingGeo
geo_2 = Geometry()
panel_9 = Panel(hairworm_randomspheremaker.Debug)
geo_3 = Geometry(hairworm_randomspheremaker.ResultingGeo)
